# Dynamo custom node v_AllElementsInDocument.dyf (Dynamo 2.3.1.11775)
# category: v-nodes.Revit.Selection
# Get all elements from the document.

refresh = Input(refresh: bool = true)
python_script = Python(IN[0]=refresh)
# ---------- python_script.python (12 lines) ----------
import clr
clr.AddReference("RevitAPI")
from Autodesk.Revit.DB import *

clr.AddReference("RevitServices")
from RevitServices.Persistence import DocumentManager

doc = DocumentManager.Instance.CurrentDBDocument

refresh = IN[0]

OUT = FilteredElementCollector(doc).WhereElementIsNotElementType().ToElements()
# ----------------------------------------
elements = Output(python_script)
