# Dynamo custom node v_AreaNotPlaced.dyf (Dynamo 2.3.0.5885)
# category: v-nodes.Revit.Area
# Determines the if the given area is not placed.

area = Input(area: var[])
code_block = CodeBlock { "Area"; }
getParameterValueByName = Element.GetParameterValueByName(element=area, parameterName=code_block)
code_block_2 = CodeBlock(area=getParameterValueByName) { area>0; }
filterByBoolMask = List.FilterByBoolMask(list=area, mask=code_block_2)
not_placed = Output(filterByBoolMask.out)
placed = Output(filterByBoolMask.in)
bool = Output(code_block_2)
