# Dynamo custom node v_ClosestNumber.dyf (Dynamo 2.6.1.8786)
# category: v-nodes.Math
# Finds the closest values in an array of numbers.

number = Input(number: var)
list_of_numbers = Input(list_of_numbers: var[])
python_script = Python(IN[0]=number, IN[1]=list_of_numbers)
# ---------- python_script.python (12 lines) ----------
n = IN[0]
nums = sorted(IN[1])

for i, num in enumerate(nums):
	if (num == n) or (num < n and i == len(nums)-1) or (num > n and i == 0):
		OUT = [num] * 3 # closest = closest_upper = closest_lower = nums[i]
	elif num < n and nums[i+1] > n:
		if n - num < nums[i+1] - n: closest = num
		else: closest = nums[i+1]
		closest_upper = nums[i+1]
		closest_lower = num
		OUT = closest, closest_upper, closest_lower
# ----------------------------------------
code_block = CodeBlock(output=python_script) { output[0]; output[1]; output[2]; }
closest = Output(code_block.out0)
closest_upper = Output(code_block.out1)
closest_lower = Output(code_block.out2)
