# Dynamo custom node v_CreateMulticategoryTag.dyf (Dynamo 2.3.1.11775)
# category: v-nodes.Revit.Tag

view = Input(view: var)
element = Input(element: var)
add_leader = Input(add_leader: bool = true)
tag_orientation = Input(tag_orientation: bool = true)
point = Input(point: Autodesk.DesignScript.Geometry.Point)
python_script = Python(IN[0]=view, IN[1]=element, IN[2]=add_leader, IN[3]=tag_orientation, IN[4]=point)
# ---------- python_script.python (38 lines) ----------
# Load the Python Standard and DesignScript Libraries
import sys
import clr
clr.AddReference('ProtoGeometry')
from Autodesk.DesignScript.Geometry import *

clr.AddReference("RevitAPI")
from Autodesk.Revit.DB import *

clr.AddReference("RevitServices")
from RevitServices.Persistence import DocumentManager
from RevitServices.Transactions import TransactionManager

clr.AddReference("RevitNodes")
import Revit
clr.ImportExtensions(Revit.GeometryConversion)
from Revit.GeometryConversion import *

doc = DocumentManager.Instance.CurrentDBDocument

view = UnwrapElement(IN[0])
element = UnwrapElement(IN[1])
add_leader = IN[2]
tag_orientation_input = IN[3]
point = UnwrapElement(IN[4])

def tag_orientation(tag_orientation_input):
	if tag_orientation_input:
		return TagOrientation.Horizontal
	else:
		return TagOrientation.Vertical


TransactionManager.Instance.EnsureInTransaction(doc)

OUT = IndependentTag.Create(doc, view.Id, Reference(element), add_leader, TagMode.TM_ADDBY_MULTICATEGORY, tag_orientation(tag_orientation_input), point.ToXyz())

TransactionManager.Instance.TransactionTaskDone()
# ----------------------------------------
tag = Output(python_script)
