# Dynamo custom node v_DoubleToString.dyf (Dynamo 2.3.0.5885)
# category: v-nodes.String.Generate
# Return a string version of float number.

number = Input(number: double)
digits = Input(digits: int = 2)
trailing_0 = Input(trailing_0: bool = true)
python_script = Python(IN[0]=number, IN[1]=digits, IN[2]=trailing_0)
# ---------- python_script.python (11 lines) ----------
number = IN[0]
digits = IN[1]
trailing = IN[2]

val = round(number, digits)
if val == int(val):
	if trailing and digits>0: OUT = str(val) + "0"*(digits-1)
	else: OUT = str(val).rstrip("0").rstrip(".")
else:
	if trailing: OUT = str(val).split(".")[0] +"."+ str(val).split(".")[1] + "0"*(digits - len(str(val).split(".")[1]))
	else: OUT = str(val)
# ----------------------------------------
str = Output(python_script)  # "str: string"
