# Dynamo custom node v_GitHubRepositoryURL.dyf (Dynamo 2.6.1.8786)
# category: v-nodes.Help&About
# Display GitHub repository using the default browser.

open_url = Input(open_url: bool = false)
python_script = Python(IN[0]=open_url)
# ---------- python_script.python (9 lines) ----------
import clr
import sys
sys.path.append('C:\Program Files (x86)\IronPython 2.7\Lib')

import webbrowser

url = "https://github.com/vlmarch/dynamo-v-nodes"
if IN[0]: webbrowser.open(url)
OUT = url
# ----------------------------------------
url = Output(python_script)
