# Dynamo custom node v_LevelPlane.dyf (Dynamo 2.3.0.5885)
# category: v-nodes.Revit.Level

code_block = CodeBlock { Plane.XY(); }
level = Input(level: var[]..[])
elevation = Level.Elevation(level=level)
offset = Plane.Offset(plane=code_block, dist=elevation)
plane = Output(offset)
