# Dynamo custom node v_RoomNotPlaced.dyf (Dynamo 2.3.1.11775)
# category: v-nodes.Revit.Room
# Determines the if the given room is not placed.

room = Input(room: var[])
area = Room.Area(room=room)
code_block = CodeBlock(area=area) { area>0; }
filterByBoolMask = List.FilterByBoolMask(list=room, mask=code_block)
placed = Output(filterByBoolMask.in)
not_placed = Output(filterByBoolMask.out)
bool = Output(code_block)
