# Dynamo custom node v_ScopeBoxIsUsed.dyf (Dynamo 2.3.1.11775)
# category: v-nodes.Revit.ScopeBox

code_block = CodeBlock { Category.ByName("Views"); }
all_elements_of_category = ElementsOfCategory(Category=code_block)
isNull = Object.IsNull(obj=all_elements_of_category)
filterByBoolMask = List.FilterByBoolMask(list=all_elements_of_category, mask=isNull)
code_block_2 = CodeBlock { "Scope Box"; }
getParameterValueByName = Element.GetParameterValueByName(element=filterByBoolMask.out, parameterName=code_block_2)
uniqueItems = List.UniqueItems(list=getParameterValueByName)
scope_box = Input(scope_box: Revit.Elements.Element[])
contains = List.Contains(list=uniqueItems, item=scope_box@L1)
bool = Output(contains)
