# Dynamo custom node v_SimplifyPolygon.dyf (Dynamo 2.3.1.11775)
# category: v-nodes.Geometry

polygon = Input(polygon: Autodesk.DesignScript.Geometry.Polygon)
explode = Geometry.Explode(geometry=polygon)
flatten = List.Flatten(list=explode)
startPoint = Curve.StartPoint(curve=flatten)
endPoint = Curve.EndPoint(curve=flatten)
byTwoPoints = Vector.ByTwoPoints(start=startPoint, end=endPoint)
normalized = Vector.Normalized(vector=byTwoPoints)
python_script = Python(IN[0]=normalized, IN[1]=startPoint)
# ---------- python_script.python (26 lines) ----------
import sys
import clr
clr.AddReference('ProtoGeometry')
from Autodesk.DesignScript.Geometry import *

vecs = IN[0]
pts = IN[1]

# Find True corner
for i, v in enumerate(vecs):
	if Vector.IsAlmostEqualTo(v, vecs[i-1]):
		vecs.append(vecs.pop(i))
		pts.append(pts.pop(i))
	else: break

# Removable points index
index = []
for i, v in enumerate(vecs[1:]):
	if Vector.IsAlmostEqualTo(v, vecs[i]):
		index.append(i+1)

# Remove points
for i, x in enumerate(index):
	del pts[x-i]

OUT = pts
# ----------------------------------------
byPoints = Polygon.ByPoints(points=python_script)
polygon_2 = Output(byPoints)  # "polygon"
