# Dynamo custom node v_SiteLocationInfo.dyf (Dynamo 2.3.1.11775)
# category: v-nodes.Revit.Document

refresh = Input(refresh: var[]..[])
python_script = Python(IN[0]=refresh)
# ---------- python_script.python (23 lines) ----------
import sys
import clr
clr.AddReference('ProtoGeometry')
from Autodesk.DesignScript.Geometry import *

clr.AddReference("RevitAPI")
from Autodesk.Revit.DB import *

clr.AddReference("RevitServices")
from RevitServices.Persistence import DocumentManager

refresh = IN[0]

doc = DocumentManager.Instance.CurrentDBDocument
site_location = doc.SiteLocation

place_name = site_location.PlaceName

latitude = UnitUtils.ConvertFromInternalUnits(site_location.Latitude, DisplayUnitType.DUT_DECIMAL_DEGREES)

longitude = UnitUtils.ConvertFromInternalUnits(site_location.Longitude, DisplayUnitType.DUT_DECIMAL_DEGREES)

OUT = place_name, latitude, longitude, site_location.TimeZone
# ----------------------------------------
code_block = CodeBlock(a=python_script) { a[0]; a[1]; a[2]; a[3]; }
place_name = Output(code_block.out0)
latitude = Output(code_block.out1)
longitude = Output(code_block.out2)
time_zone = Output(code_block.out3)
