# Dynamo custom node v_SortViews.dyf (Dynamo 2.3.1.11775)
# category: v-nodes.Revit.Views

views = Input(views: Revit.Elements.Views.View[])
python_script = Python(IN[0]=views)
# ---------- python_script.python (19 lines) ----------
# Load the Python Standard and DesignScript Libraries
import sys
import clr
clr.AddReference('ProtoGeometry')
from Autodesk.DesignScript.Geometry import *

# The inputs to this node will be stored as a list in the IN variables.
dataEnteringNode = IN
views = UnwrapElement(IN[0])

sorted_views = {}
for v in views:
	v_type = v.ViewType.ToString()
	if v_type in sorted_views:
		sorted_views[v_type].append(v)
	else:
		sorted_views[v_type] = [v]

OUT = sorted_views, sorted_views.keys(), sorted_views.values()
# ----------------------------------------
code_block = CodeBlock(a=python_script) { a[0]; a[1]; a[2]; }
dictionary = Output(code_block.out0)
keys = Output(code_block.out1)
views_2 = Output(code_block.out2)  # "views"
