# Dynamo custom node v_SortWalls.dyf (Dynamo 2.3.1.11775)
# category: v-nodes.Revit.Wall
# Sort walls based on its types.

walls = Input(walls: Revit.Elements.Wall[])
python_script = Python(IN[0]=walls)
# ---------- python_script.python (15 lines) ----------
walls = UnwrapElement(IN[0])

basic_wall = []
curtain_wall = []
stacked_wall = []

for w in walls:
	if w.CurtainGrid != None:
		curtain_wall.append(w)
	elif w.IsStackedWall:
		stacked_wall.append(w)
	else:
		basic_wall.append(w)

OUT = [basic_wall, curtain_wall, stacked_wall]
# ----------------------------------------
code_block = CodeBlock(a=python_script) { a[0]; a[1]; a[2]; }
basic_walls = Output(code_block.out0)
curtain_walls = Output(code_block.out1)
stacked_walls = Output(code_block.out2)
