# Dynamo custom node v_ViewAssociatedLevel.dyf (Dynamo 2.3.1.11775)
# category: v-nodes.Revit.Views
# The level for the view.

view = Input(view: Revit.Elements.Views.View)
python_script = Python(IN[0]=view)
# ---------- python_script.python (2 lines) ----------
view = UnwrapElement(IN[0])
OUT = view.GenLevel
# ----------------------------------------
level = Output(python_script)
