# Dynamo custom node v_ViewScopeBox.dyf (Dynamo 2.3.1.11775)
# category: v-nodes.Revit.Views

view = Input(view: Revit.Elements.Element)
code_block = CodeBlock { "Scope Box"; }
getParameterValueByName = Element.GetParameterValueByName(element=view, parameterName=code_block)
scope_box = Output(getParameterValueByName)
