# Dynamo custom node v_WatchInNotepad.dyf (Dynamo 2.3.1.11775)
# category: v-nodes.UI
# Visualize the output of node in Notepad.

code_block = CodeBlock { "\n"; }
data = Input(data: var[]..[])
string_from_object = FromObject(obj=data)
flatten = List.Flatten(list=string_from_object)
join = String.Join(separator=code_block, string0=flatten)
code_block_2 = CodeBlock(a=join) { a[0]; }
run_it = Input(run_it: bool = true)
python_script = Python(IN[0]=code_block_2, IN[1]=run_it)
# ---------- python_script.python (15 lines) ----------
import os
import uuid

desktop = os.path.join(os.path.join(os.environ['USERPROFILE']), 'Desktop')
file_path = desktop + "\\" + str(uuid.uuid4()) + ".txt"

data = IN[0]
run_it = IN[1]

if run_it:
	with open(file_path, "w") as f:
		f.write(data.encode("utf-8")) 
	os.system('Notepad "{}" && cls'.format(file_path))
	os.remove(file_path)
OUT = None
# ----------------------------------------
data_2 = Output(data)  # "data"
