# Dynamo custom node v_zfill.dyf (Dynamo 2.3.0.5885)
# category: v-nodes.String.Modify
# Return a copy of the string left filled with ASCII '0' digits to make a string of length width.

str = Input(str: string)
width = Input(width: int = 2)
python_script = Python(IN[0]=str, IN[1]=width)
# ---------- python_script.python (4 lines) ----------
data = IN[0]
width = IN[1]

OUT = data.zfill(width)
# ----------------------------------------
str_2 = Output(python_script)  # "str"
